# Grasshopper definition EUI_Computer.gh (Grasshopper 1.0.7)
# plug-ins: ClimateStudioGH

panel = Panel("""{ "shading": { "s": 0, "n": 0, "e": 0, "w": 0 },
  "wwr": { "s": 0.5, "n": 0.5, "e": 0.5, "w": 0.5 },
  "glazing": { "assembly": 0 },
  "envelope": { "walls": 0, "roofs": 0, "floors": 0, "tightness": 0 },
  "lighting": { "dimming": 0, "type": 0 },
  "hvac": { "hrv": 0, "source": 0, "fans": 0 }
}""")
geo = Geometry(<brep referenced from the Rhino model>)
pso = ParameterSensitivityOptimization(geometry=geo, run=Toggle(True), buildingParameters=panel)  # -> out, baselineResults, efficacies, labels, euis, costs, efficacies2, labels2, secondParamsLen; inputs geometry: list of Brep, run: Boolean
# ---------- pso: Python ----------
__author__ = "Sam Wolk"
__version__ = "2022.03.23"

ghenv.Component.Name = "Parameter Sensitivity Optimization"
ghenv.Component.NickName ="PSO"
        
import rhinoscriptsyntax as rs
import Grasshopper as gh
import json
import random
import time

def updateComponent():
    """ Updates this component, similar to using a grasshopper timer """
    
    # Define callback action
    def callBack(e):
        ghenv.Component.ExpireSolution(False)
        
        
    # Get grasshopper document
    ghDoc = ghenv.Component.OnPingDocument()
    
    # Schedule this component to expire
    ghDoc.ScheduleSolution(2000,gh.Kernel.GH_Document.GH_ScheduleDelegate(callBack))

def computeSim(geometry,parameters):
    print("start sim")
    cluster = gh.Kernel.Special.GH_Cluster()
    cluster.CreateFromFilePath("C:\Users\Sam Wolk\Dropbox\mit\design-optimization\EUI_Computer_Cluster.ghcluster")
    for i in range(len(geometry)):
        cluster.Params.Input[0].AddVolatileData(gh.Kernel.Data.GH_Path(0), i,geometry[i])
    cluster.Params.Input[1].AddVolatileData(gh.Kernel.Data.GH_Path(0), 0, parameters)
    doc = gh.Kernel.GH_Document()
    print("quarter sim")
    doc.Enabled = True
    print("split")
    doc.AddObject(cluster, True, 0)
    print("three eighths sim")
    structure = cluster.Params.Output[0].VolatileData
    tree = gh.DataTree[object]()
    print("mid sim")
    tree.MergeStructure(structure, gh.Kernel.Parameters.Hints.GH_NullHint())
    cost = tree.Branch(0)[0].Value
    structure = cluster.Params.Output[2].VolatileData
    tree = gh.DataTree[object]()
    tree.MergeStructure(structure, gh.Kernel.Parameters.Hints.GH_NullHint())
    eui = tree.Branch(0)[0].Value
    doc.Enabled = False
    doc.RemoveObject(cluster, False)
    doc.Dispose()
    doc = None
    print("end sim")
    return eui,cost


parameterMetadata = {
    'envelope' : {
        'roofs' : {'min':0,'max':2,'steps':3},
        'floors' : {'min':0,'max':1,'steps':2},
        'tightness':{'min':0,'max':1,'steps':2},
        'walls':{'min':0,'max':3,'steps':4}
    },
     'hvac':{
        'source':{'min':0,'max':2,'steps':3},
        'hrv':{'min':0,'max':1,'steps':2},
        'fans':{'min':0,'max':1,'steps':2}
    },
    'lighting':{
        'dimming':{'min':0,'max':1,'steps':2},
        'type':{'min':0,'max':1,'steps':2}
    },
    'wwr':{
        's':{'min':0,'max':1,'steps':20},
        'e':{'min':0,'max':1,'steps':20},
        'w':{'min':0,'max':1,'steps':20},
        'n':{'min':0,'max':1,'steps':20}
    }
 
}

placeholder = {  }

def generateParameterList(paramsToSkip=[]):
    parameterList = []
    for (category,parameters) in parameterMetadata.items():
        for (parameter,data) in parameters.items():
            shouldSkip = False
            for param in paramsToSkip:
                if param['category'] == category and param['parameter'] == parameter:
                    shouldSkip = True
                    break
            if shouldSkip:
                continue
            value = data['max']
            parameterToTest = {'category':category,'parameter':parameter,'value':value}
            parameterList.append(parameterToTest)
    random.shuffle(parameterList)
    return parameterList
    
def runParameterTest(baseline,fixedParameters,parametersToTest,results):
    testParameters = json.loads(buildingParameters)
    parameterToTest = parametersToTest.pop(0)
    category = parameterToTest['category']
    param = parameterToTest['parameter']
    testParameters[category][param] = parameterToTest['value']
    for parameter in fixedParameters:
        testParameters[parameter['category']][parameter['parameter']] = parameter['value']
    start = time.time()
    eui,cost = computeSim(geometry,json.dumps(testParameters))
    duration = time.time() - start
    result = {}
    result['category'] = parameterToTest['category']
    result['parameter'] = parameterToTest['parameter']
    result['value'] = parameterToTest['value']
    result['eui'] = eui
    result['cost'] = cost
    result['duration'] = duration
    result['euiDelta'] = eui-baseline['eui']
    result['costDelta'] = cost-baseline['cost']
    result['durationDelta'] = duration - baseline['duration']
    result['efficacy'] = result['euiDelta'] / (result['costDelta'] if result['costDelta'] != 0 else 1)
    results.append(result)
    

if 'baseline' not in globals() and run:
    start = time.time()
    eui,cost = computeSim(geometry, buildingParameters)
    duration = time.time() - start
    baseline = {'eui':eui, 'cost':cost, 'duration':duration}
    baselineResults = json.dumps(baseline)
    
if 'results' not in globals():
    results = []

if 'secondOrderResults' not in globals():
    secondOrderResults = []


if 'firstOrderComplete' not in globals(): 
    firstOrderComplete = False

if 'secondOrderComplete' not in globals():
    secondOrderComplete = False

if 'fixedParameters' not in globals():
    fixedParameters = []


if 'firstOrderParametersToTest' not in globals():
    firstOrderParametersToTest = generateParameterList()

if 'secondOrderParametersToTest' not in globals():
    secondOrderParametersToTest = []



if len(firstOrderParametersToTest) > 0 and run:
    runParameterTest(baseline,fixedParameters,firstOrderParametersToTest,results)

results.sort(key = lambda res : res['efficacy'])

if len(firstOrderParametersToTest) == 0 and len(results)>0 and not firstOrderComplete:
    firstOrderComplete = True



if firstOrderComplete and len(secondOrderParametersToTest) == 0 and not secondOrderComplete:
    bestFirstOrder = results[0]
    fixedParameters.append(bestFirstOrder)
    secondOrderParametersToTest = generateParameterList(paramsToSkip=fixedParameters)



if len(secondOrderParametersToTest) > 0 and run:
    runParameterTest(results[0],fixedParameters,secondOrderParametersToTest,secondOrderResults)

secondOrderResults.sort(key = lambda res : res['efficacy'])

if len(secondOrderParametersToTest) == 0 and len(secondOrderResults)>0 and not secondOrderComplete:
    secondOrderComplete = True


efficacies = [result['efficacy'] for result in results]
labels = [result['parameter'] for result in results]
euis = [result['eui'] for result in results]
costs = [result['cost'] for result in results]

efficacies2 = [result['efficacy'] for result in secondOrderResults]
labels2 = [result['parameter'] for result in secondOrderResults]
euis2 = [result['eui'] for result in secondOrderResults]
costs2 = [result['cost'] for result in secondOrderResults]

if run:
    updateComponent()
# ---------- end pso ----------
panel_2 = Panel(pso.out)
dam = DataDam(
    DataA=pso.efficacies,
    DataB=pso.labels,
    DataC=pso.euis,
    DataD=pso.costs,
    DataE=pso.efficacies2,
    DataF=pso.labels2,
    BufferDelay=10000000,
    BufferMode=2)  # -> DataA, DataB, DataC, DataD, DataE, DataF
plotter = CSPlotter(
    Type=1,
    Width="1000",
    Height="1000",
    Y_title="dEUI/dCost",
    X_labels=dam.DataB,
    X_rot=0,
    Y_data=dam.DataA,
    Grid_x=1,
    Show_xgrid=invert(False),
    Show_ygrid=invert(True),
    Legend=3,
    PreviewDimension=1,
    InfinateZoomDisplay=True,
    UnitSystem=4)
plotter_2 = CSPlotter(
    Type=1,
    Width="1000",
    Height="1000",
    Y_title="dEUI/dCost",
    X_labels=dam.DataF,
    X_rot=0,
    Y_data=dam.DataE,
    Grid_x=1,
    Show_xgrid=invert(False),
    Show_ygrid=invert(True),
    Legend=3,
    PreviewDimension=1,
    InfinateZoomDisplay=True,
    UnitSystem=4)
plotter_3 = CSPlotter(
    Type=3,
    Width=550,
    Height=450,
    X_title="EUI",
    Y_title="Cost",
    X_data=dam.DataD,
    X_rot=0,
    Y_data=dam.DataC,
    Range="200 to 250",
    Show_xgrid=False,
    Show_ygrid=invert(True),
    Legend=0,
    PreviewDimension=1,
    InfinateZoomDisplay=True,
    UnitSystem=4)
